# Grasshopper definition metro.gh (Grasshopper 1.0.7)
# plug-ins: LunchBox

file_path = FilePath("C:\Users\bot\projects\munich_new_metro_pbd\data\munich.csv")
read_file = ReadFile(File=file_path, PerLineParse=True)
read_csv = ReadCSV(CSVString=read_file, Delimiter=";")  # -> Headers, Values
panel = Panel(read_csv.Values)
panel_2 = Panel(read_csv.Headers)
explode_tree = ExplodeTree(Data=read_csv.Values)  # -> Branch0, Branch1, Branch2, Branch3, Branch4, Branch5
panel_3 = Panel(explode_tree.Branch0)
panel_4 = Panel(explode_tree.Branch2)
panel_5 = Panel(explode_tree.Branch5)
panel_6 = Panel(explode_tree.Branch1)
parse_polygon = CSharpScript(x=explode_tree.Branch2)  # -> out, A; inputs x: String
# ---------- parse_polygon: C# ----------
    var outList = new List<Point3d>();
    var cleanString = x.Substring(10, x.Length - 2 - 10);
    var textCoords = cleanString.Split(',');
    foreach (string textCoord in textCoords){
      var coords = textCoord.Trim().Split(' ');
      Print(textCoord);
      Print(coords.Length.ToString());
      Print("-------");
      outList.Add(new Point3d(double.Parse(coords[0]), double.Parse(coords[1]), 0));
    }
    A = outList;
# ---------- end parse_polygon ----------
panel_7 = Panel(parse_polygon.out)
panel_8 = Panel(parse_polygon.A)
polyline = PolyLine(Vertices=panel_8, Closed=True)
unit_z = UnitZ(Factor=1)
boundary_surfaces = BoundarySurfaces(Edges=polyline)
extrude = Extrude(Base=boundary_surfaces, Direction=unit_z)
